# Grasshopper definition chair.gh (Grasshopper 1.0.7)
# plug-ins: Triceratops

# ----
# GH File Location
nickname = RelativePath()

panel = Panel("/materials/leather_red_02_4k_jpg/leather_red_02_rough_4k.jpg")
panel_2 = Panel("/materials/leather_red_02_4k_jpg/leather_red_02_coll1_4k.jpg")
concat = Concatenate(FragmentA=nickname, FragmentB="/materials/plywood_4k_jpg/plywood_diff_4k.jpg")
imgsettings = ImageSettings(Saturation=1, Contrast=Slider(-0.35, range=-1..1), Lightness=0)
concat_2 = Concatenate(FragmentA=nickname, FragmentB="/materials/plywood_4k_jpg/plywood_nor_4k.jpg")
concat_3 = Concatenate(FragmentA=nickname, FragmentB=panel_2)
concat_4 = Concatenate(FragmentA=nickname, FragmentB="/materials/leather_red_02_4k_jpg/leather_red_02_nor_4k.jpg")
concat_5 = Concatenate(FragmentA=nickname, FragmentB=panel)
imgsettings_2 = ImageSettings(Saturation=Slider(-0.75, range=-1..1), Contrast=Slider(-0.5, range=-1..1), Lightness=0)
texture = Texture(ImagePath=concat, ImageSettings=imgsettings)
texture_2 = Texture(ImagePath=concat_2)
texture_3 = Texture(ImagePath=concat_3, ImageSettings=imgsettings_2)
texture_4 = Texture(ImagePath=concat_5)
texture_5 = Texture(ImagePath=concat_4)
meshstandardmaps = MeshStandardMaterialMaps(Map=texture, AlphaTest=0.5, BumpScale=1, DisplacementScale=1, NormalMap=texture_2, EnvMapIntensity=1, AoMapIntensity=1)
meshstandardmaps_2 = MeshStandardMaterialMaps(
    Map=texture_3,
    AlphaTest=0.5,
    BumpScale=1,
    DisplacementScale=1,
    NormalMap=texture_5,
    EnvMapIntensity=1,
    RoughnessMap=texture_4,
    AoMapIntensity=1)
standardmat = MeshStandardMaterial(
    Color=ColourSwatch(SwatchColor=RGB(97, 97, 97)),
    Opacity=1,
    Roughness=1,
    Metalness=0.5,
    Emissive=RGB(0, 0, 0),
    EmissiveIntensity=1,
    Maps=meshstandardmaps_2)
mesh = Mesh(<mesh referenced from the Rhino model>)
standardmat_2 = MeshStandardMaterial(
    Color=RGB(255, 255, 255),
    Opacity=1,
    Roughness=Slider(0.7, range=0..1),
    Metalness=Slider(0.2, range=0..1),
    Emissive=RGB(0, 0, 0),
    EmissiveIntensity=1,
    Maps=meshstandardmaps)
brep = Brep(<brep referenced from the Rhino model>)
mesh_2 = Mesh([<mesh referenced from the Rhino model> x10])
shadowmat = ShadowMaterial(Color=RGB(0, 0, 0), Opacity=Slider(0.1, range=0..1))
neg = Negative(Value=Slider(31, range=0..100))
neg_2 = Negative(Value=Slider(46, range=0..100))
pt = Point(<point referenced from the Rhino model>)
mesh_3 = Mesh(brep)
mesh_4 = Mesh(Mesh=mesh, Name="leather", Material=standardmat, DecimalAccuracy=3)
mesh_5 = Mesh(Mesh=mesh_2, Name="wood", Material=standardmat_2, DecimalAccuracy=3)
dirlight = DirectionalLight(
    Position=pt,
    Color=RGB(255, 255, 255),
    Intensity=Slider(0.7, range=0..1),
    Name="directional light",
    CastShadow=Toggle(True),
    ShadowTop=Slider(70, range=0..100),
    ShadowBottom=neg,
    ShadowRight=Slider(36, range=0..100),
    ShadowLeft=neg_2,
    ShadowNear=0,
    ShadowFar=Slider(221, range=0..1000))  # -> Helper, Light
hemilight = HempisphereLight(
    Color=ColourSwatch(SwatchColor=RGB(196, 231, 255)),
    GroundColor=ColourSwatch(SwatchColor=RGB(217, 205, 189)),
    Intensity=Slider(2.2, range=0..10),
    Name="hemisphere light")
mesh_6 = Mesh(Mesh=mesh_3, Name="floor", Material=shadowmat, DecimalAccuracy=3)
preview = CustomPreview(
    Geometry=dirlight.Helper,
    Material={diffuse=RGB(221, 160, 221), emission=RGB(66, 48, 66), shine=0.5, specular=RGB(255, 255, 255), transparency=0})

scene = CompileScene(Objects=[mesh_5, dirlight.Light, hemilight, mesh_6, mesh_4])
button = Button()
serialize = SerializeObject(Object3d=scene, Minify=False, Run=button)
concat_6 = Concatenate(FragmentA=nickname, FragmentB="/www/assets")
writetxt = WriteTextFile(Path=concat_6, FileName="chair.json", Data=serialize, Write=button)

# ---- group: Serve Your Website
concat_7 = Concatenate(FragmentA=nickname, FragmentB="/www")
http = HTTPServer(Path=concat_7, Run=Toggle(False))
