# Grasshopper definition example_scene.gh (Grasshopper 1.0.7)
# plug-ins: glTFexporter

crv = Curve([<curve referenced from the Rhino model> x2])
topoly = CurveToPolyline(Curve=crv, ToleranceDistance=0, ToleranceAngle=Slider(0.1, range=0..10))  # -> graft(Polyline), Segments

path = FilePath("C:\Users\dee\Desktop\vue-threejs-template\public\images\pisa\nx.png")
path_2 = FilePath("C:\Users\dee\Desktop\vue-threejs-template\public\images\pisa\ny.png")
path_3 = FilePath("C:\Users\dee\Desktop\vue-threejs-template\public\images\pisa\pz.png")
path_4 = FilePath("C:\Users\dee\Desktop\vue-threejs-template\public\images\pisa\px.png")
path_5 = FilePath("C:\Users\dee\Desktop\vue-threejs-template\public\images\pisa\nz.png")
path_6 = FilePath("C:\Users\dee\Desktop\vue-threejs-template\public\images\pisa\py.png")
nickname = CubeTexture_Component(Left=path, Front=path_3, Right=path_4, Rear=path_5, Top=path_6, Bottom=path_2, Name="cube texture")
data = Data(nickname)

path_7 = FilePath("C:\Users\dee\Desktop\vue-threejs-template\public\images\brooklyn_cube_small\left.jpg")
path_8 = FilePath("C:\Users\dee\Desktop\vue-threejs-template\public\images\brooklyn_cube_small\bottom.jpg")
path_9 = FilePath("C:\Users\dee\Desktop\vue-threejs-template\public\images\brooklyn_cube_small\front.jpg")
path_10 = FilePath("C:\Users\dee\Desktop\vue-threejs-template\public\images\brooklyn_cube_small\right.jpg")
path_11 = FilePath("C:\Users\dee\Desktop\vue-threejs-template\public\images\brooklyn_cube_small\rear.jpg")
path_12 = FilePath("C:\Users\dee\Desktop\vue-threejs-template\public\images\brooklyn_cube_small\top.jpg")
nickname_2 = CubeTexture_Component(Left=path_7, Front=path_9, Right=path_10, Rear=path_11, Top=path_12, Bottom=path_8)
data_2 = Data(nickname_2)

mesh = Mesh(<mesh referenced from the Rhino model>)
mesh_2 = Mesh(<mesh referenced from the Rhino model>)
facen = FaceNormals(Mesh=mesh_2)  # -> Centers, Normals
demesh = DeconstructMesh(Mesh=mesh)  # -> Vertices, Faces, Colours, Normals
pdecon = Deconstruct(Point=demesh.Vertices)  # -> XComponent, YComponent, ZComponent
pdecon_2 = Deconstruct(Point=facen.Centers)  # -> XComponent, YComponent, ZComponent
bang = ExplodeTree(Data=topoly.Polyline)  # -> Branch0, Branch1
addition = Addition(A=pdecon.XComponent, B=pdecon.YComponent)
addition_2 = Addition(A=pdecon_2.XComponent, B=pdecon_2.YComponent)
cp = ControlPoints(Curve=bang.Branch1)  # -> Points, Weights, Knots
cp_2 = ControlPoints(Curve=bang.Branch0)  # -> Points, Weights, Knots
sort = SortList(Keys=addition_2)  # -> Keys, ValuesA
sort_2 = SortList(Keys=addition)  # -> Keys, ValuesA
pdecon_3 = Deconstruct(Point=cp.Points)  # -> XComponent, YComponent, ZComponent
pdecon_4 = Deconstruct(Point=cp_2.Points)  # -> XComponent, YComponent, ZComponent
item = ListItem(List=reverse(sort.Keys), Index=0, Wrap=True)
item_2 = ListItem(List=sort.Keys, Index=0, Wrap=True)
item_3 = ListItem(List=reverse(sort_2.Keys), Index=0, Wrap=True)
trim = TrimTree(Tree=pdecon_3.YComponent, Depth=1)
trim_2 = TrimTree(Tree=pdecon_4.YComponent, Depth=1)
item_4 = ListItem(List=sort_2.Keys, Index=0, Wrap=True)
sort_3 = SortList(Keys=trim)  # -> Keys, ValuesA
sort_4 = SortList(Keys=trim_2)  # -> Keys, ValuesA
gradient = Gradient(
    LowerLimit=item_4,
    UpperLimit=item_3,
    Parameter=addition,
    stops=[0: RGB(255, 61, 61), 0.509: RGB(255, 178, 84), 1: RGB(255, 244, 38)])
gradient_2 = Gradient(
    LowerLimit=item_2,
    UpperLimit=item,
    Parameter=addition_2,
    stops=[0: RGB(255, 61, 61), 0.509: RGB(255, 178, 84), 1: RGB(255, 244, 38)])
panel = Panel("\TexturesCom_Bricks_Rough_2x2_1K_alpha.png")

# ----
# MeshStandardMaterial (emissive)
mesh_3 = Mesh([<mesh referenced from the Rhino model> x25])
cluster = Cluster(G=mesh_3)  # -> R, R_2
gradient_3 = Gradient(LowerLimit=0, UpperLimit=1, Parameter=cluster.R, stops=[0: RGB(255, 255, 255), 1: RGB(255, 85, 0)])
standardmat = MeshStandardMaterial(
    Color=ColourSwatch(SwatchColor=RGB(0, 178, 255)),
    Opacity=1,
    Roughness=1,
    Metalness=0.5,
    Emissive=gradient_3,
    EmissiveIntensity=cluster.R_2)
mesh_4 = Mesh(Mesh=mesh_3, Name="meshStandardMaterial", Material=standardmat, DecimalAccuracy=3)

item_5 = ListItem(List=reverse(sort_3.Keys), Index=0, Wrap=True)
item_6 = ListItem(List=reverse(sort_4.Keys), Index=0, Wrap=True)
item_7 = ListItem(List=sort_3.Keys, Index=0, Wrap=True)
item_8 = ListItem(List=sort_4.Keys, Index=0, Wrap=True)

# ----
# UV Texture
panel_2 = Panel("\UV_Grid_Sm.jpg")
nickname_3 = RelativePath()
concat = Concatenate(FragmentA=nickname_3, FragmentB=panel_2)
texture = Texture(ImagePath=concat)
meshstandardmaps = MeshStandardMaterialMaps(Map=texture, AlphaTest=0.5, BumpScale=1, DisplacementScale=1, EnvMapIntensity=1, AoMapIntensity=1)
# Mesh Textures
mesh_5 = Mesh(<mesh referenced from the Rhino model>)
mesh_6 = Mesh(<mesh referenced from the Rhino model>)
mesh_7 = Mesh(<mesh referenced from the Rhino model>)
standardmat_2 = MeshStandardMaterial(
    Color=RGB(255, 255, 255),
    Opacity=1,
    Roughness=1,
    Metalness=0.5,
    Emissive=RGB(0, 0, 0),
    EmissiveIntensity=1,
    Maps=meshstandardmaps)
merge = Merge(Data1=mesh_5, Data2=mesh_6, Data3=mesh_7)
mesh_8 = Mesh(Mesh=merge, Name="normal map", Material=standardmat_2, DecimalAccuracy=3)

# ----
# Chrome Texture
number_slider = Slider(1.5, range=0..10)
data_3 = Data(data)
meshstandardmaps_2 = MeshStandardMaterialMaps(AlphaTest=0.5, BumpScale=1, DisplacementScale=1, EnvMapIntensity=number_slider, AoMapIntensity=1)
mesh_9 = Mesh(<mesh referenced from the Rhino model>)
mesh_10 = Mesh(<mesh referenced from the Rhino model>)
mesh_11 = Mesh(<mesh referenced from the Rhino model>)
merge_2 = Merge(Data1=mesh_9, Data2=mesh_10, Data3=mesh_11)
standardmat_3 = MeshStandardMaterial(
    Color=RGB(255, 255, 255),
    Opacity=1,
    Roughness=Slider(0, range=0..100),
    Metalness=Slider(1, range=0..1),
    Emissive=RGB(0, 0, 0),
    EmissiveIntensity=1,
    Maps=meshstandardmaps_2)
mesh_12 = Mesh(Mesh=merge_2, Name="chrome", Material=standardmat_3, DecimalAccuracy=3)

crv_2 = Curve([<curve referenced from the Rhino model> x2])
crv_3 = Curve([<curve referenced from the Rhino model> x2])

# ----
# MeshBasicMaterial (wireframe)
number_slider_2 = Slider(1, range=0..10)
wireframe = Wireframe(WireframeLineJoin="round", WireframeLineWidth=number_slider_2)
mesh_13 = Mesh([<mesh referenced from the Rhino model> x3])
basicmat = MeshBasicMaterial(Color=ColourSwatch(SwatchColor=RGB(255, 132, 87)), Wireframe=wireframe)
mesh_14 = Mesh(Mesh=mesh_13, Name="meshBasicMaterial_wireframe", Material=basicmat, DecimalAccuracy=3)

crv_4 = Curve([<curve referenced from the Rhino model> x2])
gradient_4 = Gradient(LowerLimit=item_7, UpperLimit=item_5, Parameter=trim, stops=[0: RGB(255, 229, 0), 1: RGB(0, 168, 219)])
gradient_5 = Gradient(LowerLimit=item_8, UpperLimit=item_6, Parameter=trim_2, stops=[0: RGB(255, 229, 0), 1: RGB(219, 0, 168)])

# ----
# Points w/PointsMaterial + Texture
panel_3 = Panel("\triceratops-logo-medium.png")
nickname_4 = RelativePath()
concat_2 = Concatenate(FragmentA=nickname_4, FragmentB=panel_3)
texture_2 = Texture(ImagePath=concat_2)
pt = Point([<point referenced from the Rhino model> x200])
pointsmat = PointsMaterial(
    Color=ColourSwatch(SwatchColor=RGB(255, 255, 255)),
    Size=Slider(0.3, range=0..10),
    SizeAttenuation=True,
    Map=texture_2,
    AlphaTest=0.5)
points = Points(Points=pt, PointsMaterial=pointsmat, DecimalAccuracy=3)

topoly_2 = CurveToPolyline(Curve=crv_3, ToleranceDistance=0, ToleranceAngle=Slider(0.1, range=0..10))  # -> Polyline, Segments
topoly_3 = CurveToPolyline(Curve=crv_2, ToleranceDistance=0, ToleranceAngle=Slider(0.1, range=0..10))  # -> Polyline, Segments
# Line Geometry
topoly_4 = CurveToPolyline(Curve=crv_4, ToleranceDistance=0, ToleranceAngle=Slider(0.1, range=0..10))  # -> Polyline, Segments

# ----
# MeshStandardMaterial (metallic)
data_4 = Data(data)
mesh_15 = Mesh([<mesh referenced from the Rhino model> x25])
meshstandardmaps_3 = MeshStandardMaterialMaps(AlphaTest=0.5, BumpScale=1, DisplacementScale=1, EnvMapIntensity=1, AoMapIntensity=1)
cluster_2 = Cluster(G=mesh_15)  # -> R, R_2
standardmat_4 = MeshStandardMaterial(
    Color=ColourSwatch(SwatchColor=RGB(0, 178, 255)),
    Opacity=1,
    Roughness=cluster_2.R,
    Metalness=cluster_2.R_2,
    Emissive=RGB(0, 0, 0),
    EmissiveIntensity=1,
    Maps=meshstandardmaps_3)
mesh_16 = Mesh(Mesh=mesh_15, Name="meshStandardMaterial", Material=standardmat_4, DecimalAccuracy=3)

# ----
# Mesh Vertex Colors
# MeshVertexColors
# note: Both meshBasicMaterial and meshStandardMaterial components can be used with MeshVertexColors.
# 
# note: MeshVertexColors component overides any color set by the material component.
mcol = MeshColours(Mesh=mesh, Colours=gradient)
standardmat_5 = MeshStandardMaterial(Color=RGB(255, 255, 255), Opacity=1, Roughness=1, Metalness=0.5, Emissive=RGB(0, 0, 0), EmissiveIntensity=1)
meshvertex = MeshVertexColors(Mesh=mcol, Name="mesh_vertex_colors", Material=standardmat_5, DecimalAccuracy=3)

# ----
# MeshVertexColors w/Faces Colored
# note: While it looks like this component is coloring the mesh faces directly, its actually unwelding the mesh edges and coloring the vertices surrounding each face.
# note: Both meshBasicMaterial and meshStandardMaterial components can be used with MeshVertexColors.
# 
# note: MeshVertexColors component overides any color set by the material component.
colorface = MeshColorFaces(Mesh=mesh_2, Color=gradient_2)
standardmat_6 = MeshStandardMaterial(Color=RGB(255, 255, 255), Opacity=1, Roughness=1, Metalness=0.5, Emissive=RGB(0, 0, 0), EmissiveIntensity=1)
meshvertex_2 = MeshVertexColors(Mesh=colorface, Name="mesh_face_colors", Material=standardmat_6, DecimalAccuracy=3)

# ----
# MeshStandardMaterial
swatch = ColourSwatch(SwatchColor=RGB(255, 132, 87))
standardmat_7 = MeshStandardMaterial(Color=swatch, Opacity=1, Roughness=1, Metalness=0.5, Emissive=RGB(0, 0, 0), EmissiveIntensity=1)
mesh_17 = Mesh([<mesh referenced from the Rhino model> x3])
mesh_18 = Mesh(Mesh=mesh_17, Name="meshStandardMaterial", Material=standardmat_7, DecimalAccuracy=3)

# ----
# MeshBasicMaterial
swatch_2 = ColourSwatch(SwatchColor=RGB(255, 132, 87))
mesh_19 = Mesh([<mesh referenced from the Rhino model> x3])
basicmat_2 = MeshBasicMaterial(Color=swatch_2)
mesh_20 = Mesh(Mesh=mesh_19, Name="meshBasicMaterial", Material=basicmat_2, DecimalAccuracy=3)

# ----
# LineDashedMaterial
number_slider_3 = Slider(0.2, range=0..10)
linedashmat = LineDashedMaterial(
    Color=ColourSwatch(SwatchColor=RGB(77, 201, 255)),
    LineWidth=1,
    DashSize=number_slider_3,
    GapSize=Slider(0.2, range=0..10))
line = Line(Line=topoly_2.Polyline, LineMaterial=linedashmat, DecimalAccuracy=3)

# ----
# Points w/PointsMaterial
number_slider_4 = Slider(0.1, range=0..10)
pointsmat_2 = PointsMaterial(Color=ColourSwatch(SwatchColor=RGB(0, 180, 240)), Size=number_slider_4, SizeAttenuation=True, AlphaTest=0.5)
pt_2 = Point([<point referenced from the Rhino model> x200])

shadow_bottom = Slider(6, range=1..100)
shadow_left = Slider(15, range=1..100)

# ----
# LineBasicMaterial
swatch_3 = ColourSwatch(SwatchColor=RGB(77, 201, 255))
linebasicmat = LineBasicMaterial(Color=swatch_3, LineWidth=1)
line_2 = Line(Line=topoly_3.Polyline, LineMaterial=linebasicmat, DecimalAccuracy=3)

# ----
# MeshNormalMaterial
panel_4 = Panel("meshNormalMaterial")
normalmat = MeshNormalMaterial(Wireframe=False, WireframeLineJoin="round", WireframeLineWidth=1)
mesh_21 = Mesh([<mesh referenced from the Rhino model> x3])
mesh_22 = Mesh(Mesh=mesh_21, Name=panel_4, Material=normalmat, DecimalAccuracy=3)

mesh_23 = Mesh(<mesh referenced from the Rhino model>)
mesh_24 = Mesh(<mesh referenced from the Rhino model>)
mesh_25 = Mesh(<mesh referenced from the Rhino model>)

# ----
# Floor
panel_5 = Panel("meshStandardMaterial")
standardmat_8 = MeshStandardMaterial(
    Color=ColourSwatch(SwatchColor=RGB(75, 101, 125)),
    Opacity=1,
    Roughness=1,
    Metalness=0.5,
    Emissive=RGB(0, 0, 0),
    EmissiveIntensity=1)
mesh_26 = Mesh(<mesh referenced from the Rhino model>)
mesh_27 = Mesh(Mesh=mesh_26, Name=panel_5, Material=standardmat_8, DecimalAccuracy=3)

# ----
# Mesh Geometry
# Mesh
mesh_28 = Mesh([<mesh referenced from the Rhino model> x3])
mesh_29 = Mesh(Mesh=mesh_28, Name="mesh", DecimalAccuracy=3)

merge_3 = Merge(Data1=gradient_5, Data2=gradient_4)

# ----
# Dividers
swatch_4 = ColourSwatch(SwatchColor=RGB(186, 202, 217))
linebasicmat_2 = LineBasicMaterial(Color=swatch_4, LineWidth=1)
crv_5 = Curve([<curve referenced from the Rhino model> x8])
line_3 = Line(Line=crv_5, LineMaterial=linebasicmat_2, DecimalAccuracy=3)

# ----
# note: You can interpolate the colors on the vertices by welding the mesh edges.
weld = WeldMesh(Mesh=colorface, Angle=3.141592654)

# ----
# Points Geometry
# Points
pt_3 = Point(graft([<point referenced from the Rhino model> x6]))
points_2 = Points(Points=pt_3, DecimalAccuracy=3)

# ----
# Line Vertex Colors
linebasicmat_3 = LineBasicMaterial(Color=RGB(255, 255, 255), LineWidth=1)
linevertexcolors = LineVertexColors(Line=topoly.Polyline, LineMaterial=linebasicmat_3, Colors=merge_3, DecimalAccuracy=3)

# ----
# HemisphereLight
number_slider_5 = Slider(1.2, range=0..10)
hemilight = HempisphereLight(
    Color=ColourSwatch(SwatchColor=RGB(209, 240, 255)),
    GroundColor=ColourSwatch(SwatchColor=RGB(196, 176, 126)),
    Intensity=number_slider_5)

# ----
# Environmental Lighting
# AmbientLight
number_slider_6 = Slider(0.2, range=0..10)
ambientlight = AmbientLight(Color=ColourSwatch(SwatchColor=RGB(120, 210, 255)), Intensity=number_slider_6)

neg = Negative(Value=shadow_bottom)
neg_2 = Negative(Value=shadow_left)

# ----
# DirectionalLight
number_slider_7 = Slider(0.8, range=0..10)
pt_4 = Point(<point referenced from the Rhino model>)
dirlight = DirectionalLight(
    Position=pt_4,
    Color=ColourSwatch(SwatchColor=RGB(255, 254, 209)),
    Intensity=number_slider_7,
    CastShadow=Toggle(True),
    ShadowTop=Slider(41, range=1..100),
    ShadowBottom=neg,
    ShadowRight=Slider(53, range=1..100),
    ShadowLeft=neg_2,
    ShadowNear=Slider(0, range=0..10),
    ShadowFar=Slider(61, range=0..100))  # -> Helper, Light

# ----
# Line
line_4 = Line(Line=topoly_4.Polyline, DecimalAccuracy=3)

points_3 = Points(Points=pt_2, PointsMaterial=pointsmat_2, DecimalAccuracy=3)

# ----
# DirectionalLightHelper
swatch_5 = ColourSwatch(SwatchColor=RGB(255, 229, 0))
preview = CustomPreview(Geometry=dirlight.Helper, Material=swatch_5)

merge_4 = Merge(Data1=meshvertex, Data2=meshvertex_2)
merge_5 = Merge(Data1=line_4, Data2=line_2, Data3=line, Data4=linevertexcolors)
merge_6 = Merge(Data1=ambientlight, Data2=hemilight, Data3=dirlight.Light)
merge_7 = Merge(Data1=mesh_29, Data2=mesh_22, Data3=mesh_20, Data4=mesh_14, Data5=mesh_18, Data6=mesh_16, Data7=mesh_4)
path_13 = FilePath("C:\Users\dee\Desktop\Triceratops\examples\Materials\Brick\factory_brick_1k_jpg\factory_brick_diff_1k.jpg")
texture_3 = Texture(ImagePath=path_13)

# ----
# Points w/PointsMaterial + AlphaMap
panel_6 = Panel("\disc_2.png")
nickname_5 = RelativePath()
concat_3 = Concatenate(FragmentA=nickname_5, FragmentB=panel_6)
pt_5 = Point([<point referenced from the Rhino model> x200])

texture_4 = Texture(ImagePath=concat_3)

pointsmat_3 = PointsMaterial(
    Color=ColourSwatch(SwatchColor=RGB(240, 0, 128)),
    Size=Slider(0.6, range=0..10),
    SizeAttenuation=True,
    AlphaMap=texture_4,
    AlphaTest=Slider(0.5, range=0..1))
points_4 = Points(Points=pt_5, PointsMaterial=pointsmat_3, DecimalAccuracy=3)

# ----
# Brick Texture
texturesettings = TextureSettings(WrapS=0, WrapT=0, RepeatU=1, RepeatV=1, OffsetU=1, OffsetV=1, CenterU=1, CenterV=1, Rotation=0)
path_14 = FilePath("C:\Users\dee\Desktop\Triceratops\examples\Materials\Brick\factory_brick_1k_jpg\factory_brick_diff_1k.jpg")
path_15 = FilePath("C:\Users\dee\Desktop\Triceratops\examples\Materials\Brick\factory_brick_1k_jpg\factory_brick_nor_1k.jpg")
path_16 = FilePath("C:\Users\dee\Desktop\Triceratops\examples\Materials\Brick\factory_brick_1k_jpg\factory_brick_disp_1k.jpg")
path_17 = FilePath("C:\Users\dee\Desktop\Triceratops\examples\Materials\Brick\factory_brick_1k_jpg\factory_brick_rough_1k.jpg")
merge_8 = Merge(Data1=mesh_23, Data2=mesh_24, Data3=mesh_25)

texture_5 = Texture(ImagePath=path_14, Settings=texturesettings)
texture_6 = Texture(ImagePath=path_16, Settings=texturesettings)
texture_7 = Texture(ImagePath=path_15, Settings=texturesettings)
texture_8 = Texture(ImagePath=path_17, Settings=texturesettings)

meshstandardmaps_4 = MeshStandardMaterialMaps(
    Map=texture_5,
    AlphaTest=0.5,
    BumpMap=texture_6,
    BumpScale=1,
    DisplacementScale=1,
    NormalMap=texture_7,
    EnvMapIntensity=1,
    RoughnessMap=texture_8,
    AoMapIntensity=1)
standardmat_9 = MeshStandardMaterial(
    Color=RGB(255, 255, 255),
    Opacity=1,
    Roughness=1,
    Metalness=0.5,
    Emissive=RGB(0, 0, 0),
    EmissiveIntensity=1,
    Maps=meshstandardmaps_4)
mesh_30 = Mesh(Mesh=merge_8, Name="brick", Material=standardmat_9, DecimalAccuracy=3)

merge_9 = Merge(Data1=mesh_8, Data3=mesh_30, Data4=mesh_12)

# ----
# Points w/PointsMaterial + AlphaMap
panel_7 = Panel("\cross.png")
nickname_6 = RelativePath()
concat_4 = Concatenate(FragmentA=nickname_6, FragmentB=panel_7)
pt_6 = Point([<point referenced from the Rhino model> x200])

texture_9 = Texture(ImagePath=concat_4)

pointsmat_4 = PointsMaterial(
    Color=ColourSwatch(SwatchColor=RGB(240, 240, 0)),
    Size=Slider(0.3, range=0..10),
    SizeAttenuation=True,
    AlphaMap=texture_9,
    AlphaTest=Slider(0.5, range=0..1))
points_5 = Points(Points=pt_6, PointsMaterial=pointsmat_4, DecimalAccuracy=3)

merge_10 = Merge(Data1=points_2, Data2=points_3, Data3=points_4, Data4=points_5, Data5=points)

# ----
# RectAreaLight
swatch_6 = ColourSwatch(SwatchColor=RGB(255, 229, 0))
crv_6 = Curve(<curve referenced from the Rhino model>)
boundary = BoundarySurfaces(Edges=crv_6)
standardmat_10 = MeshStandardMaterial(
    Color=ColourSwatch(SwatchColor=RGB(186, 202, 217)),
    Opacity=1,
    Roughness=1,
    Metalness=0.5,
    Emissive=RGB(0, 0, 0),
    EmissiveIntensity=1)
mesh_31 = MeshBrep(
    Brep=boundary,
    Settings={GridMaxCount=0, GridMinCount=16, JaggedSeams=False, MaxEdgeLength=0, MinEdgeLength=0.0001, MinTolerance=0, Refine=True, RefineAngle=0, RelativeTolerance=0.65, SimplePlanes=True, Tolerance=0})
mesh_32 = Mesh([<mesh referenced from the Rhino model> x4])
arealight = RectAreaLight(Rectangle=crv_6, Color=swatch_6, Intensity=Slider(3, range=0..10))  # -> Helper, Light
mesh_33 = Mesh(Mesh=mesh_32, Material=standardmat_10, DecimalAccuracy=3)

basicmat_3 = MeshBasicMaterial(Color=swatch_6)

mesh_34 = Mesh(Mesh=mesh_31, Material=basicmat_3, DecimalAccuracy=3)

# ----
# RectAreaLightHelper
swatch_7 = ColourSwatch(SwatchColor=RGB(255, 229, 0))
preview_2 = CustomPreview(Geometry=arealight.Helper, Material=swatch_7)

merge_11 = Merge(Data1=mesh_34, Data2=arealight.Light, Data3=mesh_33)  # -> flatten(Result)

# ----
# SpotLight
swatch_8 = ColourSwatch(SwatchColor=RGB(0, 162, 255))
pt_7 = Point(<point referenced from the Rhino model>)
standardmat_11 = MeshStandardMaterial(
    Color=ColourSwatch(SwatchColor=RGB(186, 202, 217)),
    Opacity=1,
    Roughness=1,
    Metalness=0.5,
    Emissive=RGB(0, 0, 0),
    EmissiveIntensity=1)
# Local Lighting
msphere = MeshSphere(Base=pt_7, Radius=0.1, UCount=10, VCount=20)
mesh_35 = Mesh([<mesh referenced from the Rhino model> x4])
mesh_36 = Mesh(Mesh=mesh_35, Material=standardmat_11, DecimalAccuracy=3)
spotlight = SpotLight(
    Position=pt_7,
    Color=swatch_8,
    Intensity=Slider(3, range=0..10),
    Angle=Slider(30, range=0..100),
    Distance=0,
    Decay=1,
    CastShadow=Toggle(True),
    Name="SpotLight1")  # -> Helper, Light

basicmat_4 = MeshBasicMaterial(Color=swatch_8)

mesh_37 = Mesh(Mesh=msphere, Material=basicmat_4, DecimalAccuracy=3)

# ----
# SpotLightHelper
swatch_9 = ColourSwatch(SwatchColor=RGB(255, 229, 0))
preview_3 = CustomPreview(Geometry=spotlight.Helper, Material=swatch_9)

merge_12 = Merge(Data1=mesh_37, Data2=spotlight.Light, Data3=mesh_36)  # -> flatten(Result)

# ----
# PointLight
swatch_10 = ColourSwatch(SwatchColor=RGB(255, 13, 0))
pt_8 = Point(<point referenced from the Rhino model>)
standardmat_12 = MeshStandardMaterial(
    Color=ColourSwatch(SwatchColor=RGB(186, 202, 217)),
    Opacity=1,
    Roughness=1,
    Metalness=0.5,
    Emissive=RGB(0, 0, 0),
    EmissiveIntensity=1)
mesh_38 = Mesh([<mesh referenced from the Rhino model> x4])
ptlight = PointLight(
    Position=pt_8,
    Color=swatch_10,
    Intensity=Slider(5, range=0..10),
    Distance=Slider(5, range=0..10),
    Decay=Slider(1, range=0..10),
    CastShadow=Toggle(True),
    Name="PointLight1")  # -> Helper, Light
mesh_39 = Mesh(Mesh=mesh_38, Material=standardmat_12, DecimalAccuracy=3)

basicmat_5 = MeshBasicMaterial(Color=swatch_10)
msphere_2 = MeshSphere(Base=pt_8, Radius=0.1, UCount=10, VCount=20)

mesh_40 = Mesh(Mesh=msphere_2, Material=basicmat_5, DecimalAccuracy=3)

# ----
# PointLightHelper
swatch_11 = ColourSwatch(SwatchColor=RGB(255, 229, 0))
preview_4 = CustomPreview(Geometry=ptlight.Helper, Material=swatch_11)

merge_13 = Merge(Data1=mesh_40, Data2=ptlight.Light, Data3=mesh_39)  # -> flatten(Result)

# ----
# Labels
panel_8 = Panel("annotations")
mesh_41 = Mesh([<mesh referenced from the Rhino model> x38])

basicmat_6 = MeshBasicMaterial(Color=ColourSwatch(SwatchColor=RGB(186, 202, 217)))

mesh_42 = Mesh(Mesh=mesh_41, Name=panel_8, Material=basicmat_6, DecimalAccuracy=3)

merge_14 = Merge(Data1=mesh_42, Data2=mesh_27, Data3=line_3)
merge_15 = Merge(
    Data1=merge_7,
    Data2=merge_9,
    Data3=merge_4,
    Data4=merge_5,
    Data5=merge_10,
    Data6=merge_6,
    Data7=merge_12,
    Data8=merge_13,
    Data9=merge_11,
    Data10=merge_14)

# ----
# Compile Scene and Export
panel_9 = Panel("example_scene")
data_5 = Data(data)
button = Button()
scene = CompileScene(
    Objects=flatten(merge_15),
    Name=panel_9,
    BackgroundColor=ColourSwatch(SwatchColor=RGB(52, 201, 162)),
    Background=data_5,
    Environment=data_5)
nickname_7 = RelativePath()
serialize = SerializeObject(Data=scene, Minify=Toggle(False), Run=button)
json = ExportJSON(Path="C:\Users\dee\Desktop\vue-threejs-template\public\3d", FileName="example_scene.json", Data=serialize, Write=button)

# ==== cluster Cluster
G = ClusterInput()
area = Area(Geometry=G)  # -> Area, Centroid
pdecon = Deconstruct(Point=area.Centroid)  # -> XComponent, YComponent, ZComponent
sort = SortList(Keys=pdecon.YComponent)  # -> Keys, ValuesA
sort_2 = SortList(Keys=pdecon.XComponent)  # -> Keys, ValuesA
item = ListItem(List=reverse(sort.Keys), Index=0, Wrap=True)
item_2 = ListItem(List=reverse(sort_2.Keys), Index=0, Wrap=True)
item_3 = ListItem(List=sort.Keys, Index=0, Wrap=True)
item_4 = ListItem(List=sort_2.Keys, Index=0, Wrap=True)
dom = ConstructDomain(DomainStart=item_3, DomainEnd=item)
dom_2 = ConstructDomain(DomainStart=item_4, DomainEnd=item_2)
remap = RemapNumbers(Value=pdecon.XComponent, Source=dom_2, Target=Domain(0, 1))  # -> Mapped, Clipped
remap_2 = RemapNumbers(Value=pdecon.YComponent, Source=dom, Target=Domain(0, 1))  # -> Mapped, Clipped
R = ClusterOutput(remap.Mapped)
R_2 = ClusterOutput(remap_2.Mapped)
